# Grasshopper definition main.ghx (Grasshopper 1.0.7)
# plug-ins: Human, Shortest Walk in Gh, MeshEdit Components, Arachne, Heteroptera, Anemone

number_slider = Slider(10, range=0..10)
rectangle = Rectangle(Plane=PlaneXY(0, 0, 0), XSize=number_slider, YSize=number_slider, Radius=0)  # -> Rectangle, Length
number_slider_2 = Slider(10, range=0..10)
number_slider_3 = Slider(10, range=0..10)
rectangular_array = RectangularArray(Geometry=rectangle.Rectangle, Cell=rectangle.Rectangle, XCount=number_slider_2, YCount=number_slider_3)  # -> Geometry, Transform

random = Random(Range=Domain(0, 1), Number=Slider(10, range=0..10), Seed=2)
list_length = ListLength(List=rectangular_array.Geometry)  # -> expr("x-1", Length)
remap_numbers = RemapNumbers(Value=random, Source=Domain(0, 1), Target=list_length)  # -> Mapped, Clipped
integer = Integer(remap_numbers.Mapped)
custom_preview_lineweights = CustomPreviewLineweights(Geometry=rectangular_array.Geometry, Shader=ColourSwatch(SwatchColor=RGB(8, 0, 255)), Absolute=False)
list_item = ListItem(List=rectangular_array.Geometry, Index=integer, Wrap=False)
surface = Surface(list_item)
surface_2 = Surface(rectangular_array.Geometry)
area = Area(Geometry=surface_2)
custom_preview = CustomPreview(Geometry=surface, Material=ColourSwatch(SwatchColor=RGB(8, 0, 255)))
mesh_frompoints = MeshFromPoints(Points=area, UDirection=number_slider_2, VDirection=number_slider_3)
geometry = Geometry(rectangular_array.Geometry)
area_2 = Area(Geometry=list_item)
mesh_to_graph = MeshToGraph(Mesh=mesh_frompoints)
cull_index = CullIndex(List=geometry, Indices=integer, Wrap=True)

average = Average(Input=random)
list_length_2 = ListLength(List=cull_index)  # -> expr("x-1", Length)
remap_numbers_2 = RemapNumbers(Value=average, Source=Domain(0, 1), Target=list_length_2)  # -> Mapped, Clipped
integer_2 = Integer(remap_numbers_2.Mapped)

deconstruct_graph = DeconstructGraph(Graph=mesh_to_graph)  # -> Vertices, Edges, Geo
list_length_3 = ListLength(List=area_2)
closest_point = ClosestPoint(Point=area_2, Cloud=deconstruct_graph.Vertices)  # -> ClosestPoint, CPIndex, Distance
shortest_walk = ShortestWalk()  # -> ShortestWalk, Succession, Direction, Length
shortest_route = ShortestRoute()  # -> Nodes, Segments, Cost
delete_vertices = DeleteVertices(Mesh=mesh_frompoints, Shrink=False)
list_item_2 = ListItem(List=geometry, Index=integer_2, Wrap=True)
area_3 = Area(Geometry=list_item_2)
closest_point_2 = ClosestPoint(Point=area_3, Cloud=deconstruct_graph.Vertices)  # -> ClosestPoint, CPIndex, Distance
fast_loop_start = FastLoopStart(Iterations=list_length_3, Mesh=mesh_frompoints, Start=closest_point_2.CPIndex)  # -> port, Counter, Data, Start, Data_2, Data_3
shortest_path = ShortestPath(Graph=mesh_to_graph, Start=closest_point_2.CPIndex, End=closest_point.CPIndex)  # -> simplify(IndexList)
list_item_3 = ListItem(List=deconstruct_graph.Vertices, Index=shortest_path, Wrap=True)
surface_3 = Surface(list_item_2)
polyline = PolyLine(Vertices=list_item_3, Closed=False)
curve = Curve(flatten(polyline))
length = Length(Curve=curve)
custom_preview_2 = CustomPreview(Geometry=surface_3, Material=ColourSwatch(SwatchColor=RGB(255, 0, 0)))
sort_list = SortList(Keys=length, ValuesA=curve)  # -> Keys, ValuesA
list_item_4 = ListItem(List=sort_list.ValuesA, Index=0, Wrap=True)
fast_loop_end = FastLoopEnd(port=fast_loop_start.port, Exit=False, Data_3=list_item_4, RecordData=False, TimeOutVal=0)  # -> Mesh, Start, End, Prev
discontinuity = Discontinuity(Curve=list_item_4, Level=1)  # -> Points, Parameters
closest_point_3 = ClosestPoint(Point=discontinuity.Points, Cloud=area)  # -> ClosestPoint, CPIndex, Distance
list_item_5 = ListItem(List=surface_2, Index=closest_point_3.CPIndex, Wrap=True)
list_length_4 = ListLength(List=list_item_5)
split_list = SplitList(List=list_item_5, Index=Slider(100, range=0..100))  # -> ListA, ListB
remap_numbers_3 = RemapNumbers(Source=list_length_4, Target=Slider(100, range=0..100))  # -> Mapped, Clipped
surface_4 = Surface()
panel = Panel(sort_list.Keys)
